# Grasshopper definition sunpath_examle.gh (Grasshopper 1.0.7)
# plug-ins: GHSolar

panel = Panel([Slider(8.542, range=-90..90), Slider(47.377, range=-90..90)])
pt = Point(Point(1.091604067, -23.08659905, 0))
skydome = GHSkydome(RecursionLevel="2", Viewfactors="true", CumSkyMatrix="true", HOY=Slider(3050, range=0..8759), Location=panel, Sp=pt)  # -> Mesh, Vectors, Sunpaths
